# Grasshopper definition 190705_Chainsaw_setup.gh (Grasshopper 1.0.7)
# plug-ins: Robots

crv = Curve(reparameterize(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))
brep = Brep(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)
pframe = PerpFrame(Curve=crv, Parameter=".5")
debrep = DeconstructBrep(Brep=brep)  # -> Faces, Edges, Vertices
scale = Scale(Geometry=crv, Center=pframe, Factor=0.5)  # -> Geometry, Transform
colom = CollisionOneMany(Collider=debrep.Faces, Obstacles=scale.Geometry)  # -> Collision, Index
pl_offset = PlaneOffset(BasePlane=pframe, Offset=Slider(-115, range=-500..500))
cull = CullPattern(List=debrep.Faces, CullPattern=colom.Collision)
item = ListItem(List=cull, Index=0, Wrap=True)
sec = BrepPlane(Brep=item, Plane=pframe)  # -> Curves, Points
pl = ConstructPlane(Origin=pframe, XAxis=crv, YAxis=sec.Curves)
line = LineSDL(Start=pl_offset, Direction=sec.Curves, Length=Slider(98, range=0..1000))
end = EndPoints(Curve=line)  # -> Start, End
pl_origin = PlaneOrigin(Base=pl, Origin=end.End)
pl_origin_2 = PlaneOrigin(Base=pl, Origin=end.Start)
merge = Merge(Data1=pl_origin, Data2=pl_origin_2, Data3=pl_origin)
rotax = RotateAxis(Geometry=merge, Angle=1.570796327, Axis=crv)  # -> Geometry, Transform

neg = Negative(Value="2")
pl_offset_2 = PlaneOffset(BasePlane=rotax.Geometry, Offset=neg)

brep_2 = Brep([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])
brep_3 = Brep([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])
preview = CustomPreview(Geometry=brep_3, Material=ColourSwatch(SwatchColor=RGB(46, 46, 46)))
preview_2 = CustomPreview(Geometry=brep_2, Material=ColourSwatch(SwatchColor=RGB(69, 69, 69)))

pl_offset_3 = PlaneOffset(BasePlane=merge, Offset=neg)
merge_2 = Merge(Data1=pl_offset_3, Data2=pl_offset_2)

pt = Point(Point(844.0781001, 69.83735723, 1407.790037))
xz = XZPlane(Origin=pt)
ins = InsertItems(List=merge_2, Item=xz, Indices=0, Wrap=True)
prot = RotatePlane(Plane=ins, Angle="pi")

list = ValueList({"Indexlab_ABB_IRB4600_205", "Indexlab_UR10"}, selected="Indexlab_ABB_IRB4600_205")
load_robot = LoadRobotSystem(Name=list, Base=PlaneXY(0, 0, 0))

Z = UnitZ(Factor="10")
move = Move(Geometry=prot, Motion=Z)  # -> Geometry, Transform

panel = Panel("""50
50
5
5
25
5
5""")
list_2 = ValueList({"Joint", "Linear"}, selected="Linear")
multiplication = Multiplication(A=panel, B=2)
num = Number(multiplication)
knob = ControlKnob(Decimals=2, Limit=True, Maximum=10, Minimum=0, Range=1, Value=0)

Z_2 = UnitZ(Factor="12")
P = Point(Point(-176.8542416, -79.59063018, 317.9974109))
move_2 = Move(Geometry=P, Motion=Z_2)  # -> Geometry, Transform
srf = Surface(reparameterize(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))
srf_cp = SurfaceClosestPoint(Point=move_2.Geometry, Surface=srf)  # -> Point, UVPoint, Distance
evalsrf = EvaluateSurface(Surface=srf, Point=srf_cp.UVPoint)  # -> Point, Normal, UDirection, VDirection, Frame
brep_4 = Brep([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])
pflip = FlipPlane(Plane=evalsrf.Frame, ReverseX="true", ReverseY=False, SwapAxes=False)
mesh = MeshBrep(
    Brep=brep_4,
    Settings={GridMaxCount=0, GridMinCount=16, JaggedSeams=False, MaxEdgeLength=0, MinEdgeLength=0.0001, MinTolerance=0, Refine=True, RefineAngle=0, RelativeTolerance=0.65, SimplePlanes=True, Tolerance=0})
mjoin = MeshJoin(Meshes=mesh)

prot_2 = RotatePlane(Plane=pflip, Angle=degrees("4"))

tool = CreateTool(Name="chainsawtool", TCP=prot_2, Weight=0, Mesh=mjoin)  # -> Tool, TCP

target = CreateTarget(Plane=move.Geometry, Motion=list_2, Tool=tool.Tool, Speed=num, IsCartesian=True)
program = CreateProgram(Name="chainsawCUT08", RobotSystem=load_robot, Targets1=target, StepSize=1)  # -> Program, Code, Duration, Warnings, Errors
bang = ExplodeTree(Data=program.Code)  # -> _000000, _000001

panel_2 = Panel("C:\Users\Carlo\Desktop\Chainsaw_Programs")
saveprog = SaveProgram(Program=program.Program, Folder="C:\Users\A. El Maraghy\Desktop")

sim = ProgramSimulation(Program=program.Program, Time=knob, Normalized=True)  # -> SystemMeshes, JointRotations, Plane, Index, Time, Program, Errors

preview_3 = CustomPreview(Geometry=sim.SystemMeshes, Material=ColourSwatch(SwatchColor=RGB(201, 201, 201)))

item_2 = ListItem(List=sim.Plane, Index=-1, Wrap=True)
pln = Plane(item_2)

panel_3 = Panel("""20.42
-29.72
70.13
-86.91
87.28
40.27""")
panel_4 = Panel("""12.78
-33.11
40.86
0.5
82.53
-10.21""")
degtorad = DegreesToRadians(Degrees=panel_4, RobotSystem=load_robot, MechanicalGroup=0)
target_2 = CreateTarget(Joints=degtorad, Tool=tool.Tool, Speed="100", IsCartesian=False)
